# Grasshopper definition GHcomponent_CurtainWall.gh (Grasshopper 1.0.7)
# plug-ins: Grasshopper-BricsCAD-Connection, Pufferfish, LunchBox

# INPUT BRICSCAD
# PARAMETERS HERE
# (start with BcIn_)
bcin_heightsecondtpanel = Number(2400)
bcin_heightfirstpanel = Number(1200)
bcin_horprofilewidth = Number(80)
bcin_horprofiledepth = Number(100)
bcin_horoffsetdepth = Number(30)
bcin_vertprofilewidth = Number(120)
bcin_vertprofiledepth = Number(200)
bcin_aproxspacing = Number(1500)
bcin_thicknesspanel = Number(100)
bcin_offsetpanel = Number(-20)
bcin_thicknessglass = Number(18)
bcin_offsetglass = Number(100)
bcin_vertprofilefinwidth = Number(80)
# INPUT BRICSCAD WALL HERE
# (start with BcIn_)
bcin_vertprofilefindepth = Number(-400)
bcin_heightthirdpanel = Number(1600)
bcin_entity = Entity({BcDocName="test", Handle=2181, Index=0, SubentityType=0})
height_of_second_panel = Panel(bcin_heightfirstpanel)
width_of_rafter = Panel(bcin_horprofilewidth)
depth_of_rafter = Panel(bcin_horprofiledepth)
depth_of_rafter_2 = Panel(bcin_horoffsetdepth)
width_of_rafter_2 = Panel(bcin_vertprofilewidth)
depth_of_rafter_3 = Panel(bcin_vertprofiledepth)
panel_spacing_width = Panel(bcin_aproxspacing)
height_of_second_panel_2 = Panel(bcin_heightsecondtpanel)
height_of_third_panel = Panel(bcin_heightthirdpanel)
thickness_panel = Panel(bcin_thicknesspanel)
offset_panel = Panel(bcin_offsetpanel)
thickness_glass = Panel(bcin_thicknessglass)
offset_glass = Panel(bcin_offsetglass)
width_of_rafter_3 = Panel(bcin_vertprofilefinwidth)
depth_of_rafter_4 = Panel(bcin_vertprofilefindepth)

# ---- group: Get bim name and spatial location of
input_solid = Entity(bcin_entity)
property_category = PropertyCategories({"Standard": 0, "Bricsys": 1, "IFC2x3": 2, "IFCCustom": 3, "User": 4, "Quantity": 5, "Classfication": 6, "IFC4": 7}, selected="Bricsys")
pv = PropertyValue(BuildingElement=input_solid, PropName="Name", PropCategory=property_category)
pv_2 = PropertyValue(BuildingElement=input_solid, PropName="SpatialLocation", PropCategory=property_category)
name = Panel(pv)
spatial_loc = Panel(pv_2)

# ---- group: assign bim data
original_name = Panel(pv)
panel = Panel("SpatialLocation")

# ---- group: retrieve largest face in solid pick the top one
debrep = DeconstructBrep(Brep=bcin_entity)  # -> simplify(Faces), Edges, Vertices
area = Area(Geometry=debrep.Faces)  # -> Area, Centroid
sort = SortList(Keys=area.Area, ValuesA=debrep.Faces)  # -> Keys, ValuesA

# ----
lng = ListLength(List=debrep.Faces)

# ---- group: retrieve largest face in solid pick the top one (continued)
split = SplitList(List=sort.ValuesA, Index=expr("x-1", lng))  # -> ListA, ListB
srf = Surface(split.ListB)

# ---- group: create axislines
srf_2 = Surface(split.ListB)
srf_3 = Surface(split.ListB)

# ---- group: create axislines / detect horizontal lines
rad = Radians(Degrees=5)
Z = UnitZ(Factor=1)
debrep_2 = DeconstructBrep(Brep=srf_2)  # -> simplify(Faces), Edges, Vertices
edgesdir = EdgesFromDirections(Brep=srf_2, Directions=Z, Reflex=True, Angle=rad)  # -> Edges, Indices, Map
dispdexs = DispatchIndices(List=debrep_2.Edges, Indices=edgesdir.Indices)  # -> AtI, NotI
horizontal_outer_edges = Curve(dispdexs.NotI)
# ;This is an example script provided with the installation of BricsCAD V22.
# ;
# ;This script is provided AS IS without warranty of any kind. Author(s) disclaim all
# ;implied warranties including, without limitation, any implied warranties of
# ;merchantability or of fitness for a particular purpose. The entire risk arising out of
# ;the use or performance of the sample script and documentation remains with you. In no
# ;event shall author(s) be held liable for any damages whatsoever (including, without
# ;limitation, damages for loss of business profits, business interruption, loss of business
# ;information, or other pecuniary loss) arising out of the use of or inability to use the
# ;script or documentation. The script is not guaranteed to work with future or previous
# ;versions of BricsCAD except the one it is installed with. The presensce of the script in
# ;future versions is not guaranteed and is a subject to change within any future update to
# ;BricsCAD.
# 
# This script takes a solid as input and will generate curtain wall elements.
# The largest surface of the solid is used as base geometry. Horizontal lines are filtered out, the bottom one is used to create the first, secondary and third horizontal member (you can avoid the creation of horizontal members by putting the value to 0).
# The number of vertical members is calculated based on the spacing.
# The horizontal lines are divided in segments to make the script work on curved walls.
# The profile are orientated and lofted.
# All elements are classified and get a name based on the name of the original wall/slab and a composition.
midpt = CurveMiddle(Curve=horizontal_outer_edges)
pdecon = Deconstruct(Point=midpt)  # -> XComponent, YComponent, ZComponent
sort_2 = SortList(Keys=pdecon.ZComponent, ValuesA=horizontal_outer_edges)  # -> Keys, ValuesA
horizontal_outer_edges_sorted = Curve(flatten(sort_2.ValuesA))

# ---- group: create axislines / create secondary hor en vert lines (copy bottom edge verticalyl)
heightthirdpanel = Number(bcin_heightthirdpanel)
heightsecondpanel = Number(bcin_heightsecondtpanel)
heightfirstpanel = Number(bcin_heightfirstpanel)
item = ListItem(List=sort_2.Keys, Index=0, Wrap=True)
addition = Addition(A=heightfirstpanel, B=item)
addition_2 = Addition(A=heightsecondpanel, B=heightfirstpanel, C=item)
addition_3 = Addition(A=heightthirdpanel, B=heightfirstpanel, C=heightsecondpanel, D=item)
pt = ConstructPoint(XCoordinate=0, YCoordinate=0, ZCoordinate=addition)
pt_2 = ConstructPoint(XCoordinate=0, YCoordinate=0, ZCoordinate=addition_2)
pt_3 = ConstructPoint(XCoordinate=0, YCoordinate=0, ZCoordinate=addition_3)
len = Length(Curve=horizontal_outer_edges_sorted)
xy = XYPlane(Origin=pt_2)
xy_2 = XYPlane(Origin=pt_3)
avr = Average(Input=len)
xy_3 = XYPlane(Origin=pt)
aproxspacing = Number(bcin_aproxspacing)
division = Division(A=avr, B=aproxspacing)
round = Round(Number=division)  # -> Nearest, Floor, Ceiling
sec = BrepPlane(Brep=srf_3, Plane=xy)  # -> Curves, Points
sec_2 = BrepPlane(Brep=srf_3, Plane=xy_2)  # -> Curves, Points
sec_3 = BrepPlane(Brep=srf_3, Plane=xy_3)  # -> Curves, Points
divide = DivideCurve(Curve=horizontal_outer_edges_sorted, Count=round.Nearest, Kinks=False)  # -> simplify(Points), Tangents, Parameters
top_rail_first_panel = Curve(sec_3.Curves)
top_rail_third_panel = Curve(sec_2.Curves)
top_rail_second_panel = Curve(sec.Curves)
branch = TreeBranch(Tree=divide.Points, Path="{0}", MaintainPaths=True)
branch_2 = TreeBranch(Tree=divide.Points, Path="{1}", MaintainPaths=True)
merge = Merge(Data1=top_rail_third_panel, Data2=top_rail_second_panel, Data3=top_rail_first_panel, Data4=horizontal_outer_edges_sorted)  # -> flatten(Result)
rev = ReverseList(List=branch_2)
sort_crv = SortDuplicateCurves(Curves=merge)  # -> flatten(UniqueCurves), Indices
merge_2 = Merge(Data1=top_rail_second_panel, Data2=top_rail_first_panel)
ln = Line(StartPoint=branch, EndPoint=rev)
horizontals = Curve(sort_crv.UniqueCurves)
verticals = Curve(ln)

# ---- group: create geometry / Horizontal create and align profiles
verticals_2 = Curve(verticals)
horizontals_2 = Curve(horizontals)
lng_2 = ListLength(List=verticals_2)
divide_2 = DivideCurve(Curve=flatten(horizontals_2), Count=expr("x-1", lng_2), Kinks=False)  # -> Points, Tangents, Parameters
srf_4 = Surface(srf)
brep_cp = BrepClosestPoint(Point=divide_2.Points, Brep=srf_4)  # -> Point, Normal, Distance
crvdom = CurveDomain(Curve=horizontals_2)  # -> Curve, Domain
vec_perp_surface = Vector(brep_cp.Normal)
dedomain = DeconstructDomain(Domain=crvdom.Domain)  # -> Start, End
xprod = CrossProduct(VectorA=vec_perp_surface, VectorB=divide_2.Tangents, Unitize=True)  # -> Vector, Length
pl = ConstructPlane(Origin=divide_2.Points, XAxis=xprod.Vector, YAxis=expr("-x", vec_perp_surface))
horprofilewidth = Number(bcin_horprofilewidth)
horprofiledepth = Number(bcin_horprofiledepth)
horoffsetdepth = Number(bcin_horoffsetdepth)
amp = Amplitude(Vector=vec_perp_surface, Amplitude=expr("-x", horoffsetdepth))
rectangle = Rectangle(Plane=pl, XSize=horprofilewidth, YSize=horprofiledepth, Radius=0)  # -> Rectangle, Length
move = Move(Geometry=rectangle.Rectangle, Motion=amp)  # -> Geometry, Transform
loft = Loft(Curves=move.Geometry, Options={Adjust=False, Closed=False, LoftEnds=0, LoftSimp=0, LoftType=0, Rebuild=10, Refit=0.01})
cap = CapHoles(Brep=loft)

# ---- group: create geometry / Vertical create and align profiles
verticals_3 = Curve(verticals)
divide_3 = DivideCurve(Curve=flatten(verticals_3), Count=1, Kinks=False)  # -> Points, Tangents, Parameters
srf_5 = Surface(srf)
brep_cp_2 = BrepClosestPoint(Point=divide_3.Points, Brep=srf_5)  # -> Point, Normal, Distance
verticals_4 = Curve(verticals)
crvdom_2 = CurveDomain(Curve=verticals_4)  # -> Curve, Domain
dedomain_2 = DeconstructDomain(Domain=crvdom_2.Domain)  # -> Start, End
eval = EvaluateCurve(Curve=verticals_4, Parameter=dedomain_2.Start)  # -> Point, Tangent, Angle
vec_perp_surface_2 = Vector(brep_cp_2.Normal)
xprod_2 = CrossProduct(VectorA=vec_perp_surface_2, VectorB=divide_3.Tangents, Unitize=True)  # -> Vector, Length
pl_2 = ConstructPlane(Origin=divide_3.Points, XAxis=xprod_2.Vector, YAxis=expr("-x", vec_perp_surface_2))
vertprofilewidth = Number(bcin_vertprofilewidth)
vertprofiledepth = Number(bcin_vertprofiledepth)
rectangle_2 = Rectangle(Plane=pl_2, XSize=vertprofilewidth, YSize=vertprofiledepth, Radius=0)  # -> Rectangle, Length
loft_2 = Loft(
    Curves=rectangle_2.Rectangle,
    Options={Adjust=False, Closed=False, LoftEnds=0, LoftSimp=0, LoftType=0, Rebuild=10, Refit=0.01})
cap_2 = CapHoles(Brep=loft_2)

# ---- group: create geometry / split surface to create panels, bottom and top panels aluminium, middle in glass
srf_6 = Surface(srf)
top_rail_second_panel_2 = Curve(top_rail_second_panel)
top_rail_first_panel_2 = Curve(merge_2)
srfsplit = SurfaceSplit(Surface=srf_6, Curves=top_rail_first_panel_2)
srfsplit_2 = SurfaceSplit(Surface=srf_6, Curves=top_rail_second_panel_2)
area_2 = Area(Geometry=srfsplit)  # -> Area, Centroid
area_3 = Area(Geometry=srfsplit_2)  # -> Area, Centroid
pdecon_2 = Deconstruct(Point=area_2.Centroid)  # -> XComponent, YComponent, ZComponent
pdecon_3 = Deconstruct(Point=area_3.Centroid)  # -> XComponent, YComponent, ZComponent
sort_3 = SortList(Keys=pdecon_2.ZComponent, ValuesA=srfsplit)  # -> Keys, ValuesA
sort_4 = SortList(Keys=pdecon_3.ZComponent, ValuesA=srfsplit_2)  # -> Keys, ValuesA
item_2 = ListItem(List=sort_3.ValuesA, Index=0, Wrap=True)
item_3 = ListItem(List=sort_3.ValuesA, Index=1, Wrap=True)
item_4 = ListItem(List=sort_4.ValuesA, Index=1, Wrap=True)
offsetpanel = Number(bcin_offsetpanel)
offsetglass = Number(bcin_offsetglass)
thicknesspanel = Number(bcin_thicknesspanel)
thicknessglass = Number(bcin_thicknessglass)
offset = OffsetSurface(Surface=item_3, Distance=expr("-x", offsetglass), Retrim=True)
offset_2 = OffsetSurface(Surface=item_2, Distance=expr("-x", offsetpanel), Retrim=True)
offset_3 = OffsetSurface(Surface=item_4, Distance=expr("-x", offsetpanel), Retrim=True)
offsrf = OffsetSurface(Surface=offset, Distance=expr("-x", thicknessglass), BothSides=0, CreateSolid=True)
offsrf_2 = OffsetSurface(Surface=offset_2, Distance=expr("-x", thicknesspanel), BothSides=0, CreateSolid=True)
offsrf_3 = OffsetSurface(Surface=offset_3, Distance=expr("-x", thicknesspanel), BothSides=0, CreateSolid=True)

# ---- group: create geometry / vertical fins loft and cap profiles
vertprofilefinwidth = Number(width_of_rafter_3)
vertprofilefindepth = Number(depth_of_rafter_4)
rectangle_3 = Rectangle(Plane=pl_2, XSize=vertprofilefinwidth, YSize=vertprofilefindepth, Radius=0)  # -> Rectangle, Length
subtraction = Subtraction(A=vertprofilewidth, B=vertprofilefinwidth)
amp_2 = Amplitude(Vector=xprod_2.Vector, Amplitude=expr("x/2", subtraction))
move_2 = Move(Geometry=rectangle_3.Rectangle, Motion=amp_2)  # -> Geometry, Transform
loft_3 = Loft(Curves=move_2.Geometry, Options={Adjust=False, Closed=False, LoftEnds=0, LoftSimp=0, LoftType=0, Rebuild=10, Refit=0.01})
cap_3 = CapHoles(Brep=loft_3)
fins = Brep(flatten(cap_3))

# ---- group: create geometry
botton_panel = Brep(offsrf_2)
top_panel = Brep(offsrf_3)
glass = Brep(offsrf)
colums = Brep(flatten(cap_2))
beams = Brep(flatten(cap))

# ---- group: OUTPUT GEOMETRY
beams_2 = Brep(beams)
glass_2 = Brep(glass)
fins_2 = Brep(fins)
bottom_panel = Brep(botton_panel)
top_panel_2 = Brep(top_panel)

# ----
colums_2 = Brep(colums)
merge_3 = Merge(Data1=beams_2, Data2=colums_2, Data3=glass_2, Data4=bottom_panel, Data5=top_panel_2, Data6=fins_2)
preview_brep = Brep(merge_3)

# ---- group: assign bim data / assign BIM type
bim_type = BIMTypes({"BimGenericBuildingElt": 0, "BimSection": 1, "BimWall": 2, "BimWindow": 3, "BimDoor": 4, "BimColumn": 5, "BimSlab": 6, "BimBeam": 7, "BimRoom": 8, "BimCovering": 9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}, selected="BimBeam")
bim_type_2 = BIMTypes({"BimGenericBuildingElt": 0, "BimSection": 1, "BimWall": 2, "BimWindow": 3, "BimDoor": 4, "BimColumn": 5, "BimSlab": 6, "BimBeam": 7, "BimRoom": 8, "BimCovering": 9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}, selected="BimColumn")
bim_type_3 = BIMTypes({"BimGenericBuildingElt": 0, "BimSection": 1, "BimWall": 2, "BimWindow": 3, "BimDoor": 4, "BimColumn": 5, "BimSlab": 6, "BimBeam": 7, "BimRoom": 8, "BimCovering": 9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}, selected="BimCovering")
bim_type_4 = BIMTypes({"BimGenericBuildingElt": 0, "BimSection": 1, "BimWall": 2, "BimWindow": 3, "BimDoor": 4, "BimColumn": 5, "BimSlab": 6, "BimBeam": 7, "BimRoom": 8, "BimCovering": 9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}, selected="BimMember": 13)
bbe = BakeBuildingElement(Geometry=beams_2, ElementType=bim_type)
bbe_2 = BakeBuildingElement(Geometry=colums_2, ElementType=bim_type_2)
bbe_3 = BakeBuildingElement(Geometry=glass_2, ElementType=bim_type_3)
bbe_4 = BakeBuildingElement(Geometry=bottom_panel, ElementType=bim_type_3)
bbe_5 = BakeBuildingElement(Geometry=top_panel_2, ElementType=bim_type_3)
bbe_6 = BakeBuildingElement(Geometry=fins_2, ElementType=bim_type_4)

# ---- group: assign bim data / assign name based on original name + type
concat = Concatenate(FragmentA=original_name, FragmentB=" column")
concat_2 = Concatenate(FragmentA=original_name, FragmentB=" beam")
concat_3 = Concatenate(FragmentA=original_name, FragmentB=" Member")
concat_4 = Concatenate(FragmentA=original_name, FragmentB=" glass panel")
concat_5 = Concatenate(FragmentA=original_name, FragmentB="bottom panel")
concat_6 = Concatenate(FragmentA=original_name, FragmentB=" top panel")
sp = SetProperty(BuildingElement=bbe, PropName="Name", PropVal=concat, PropCategory="1")
sp_2 = SetProperty(BuildingElement=bbe_2, PropName="Name", PropVal=concat_2, PropCategory="1")
sp_3 = SetProperty(BuildingElement=bbe_6, PropName="Name", PropVal=concat_3, PropCategory="1")
sp_4 = SetProperty(BuildingElement=bbe_3, PropName="Name", PropVal=concat_4, PropCategory="1")
sp_5 = SetProperty(BuildingElement=bbe_4, PropName="Name", PropVal=concat_5, PropCategory="1")
sp_6 = SetProperty(BuildingElement=bbe_5, PropName="Name", PropVal=concat_6, PropCategory="1")

# ---- group: assign bim data / assign composition
merge_4 = Merge(Data1=bbe, Data2=bbe_2, Data3=bbe_4, Data4=bbe_5, Data5=bbe_6)
sp_7 = SetProperty(BuildingElement=bbe_3, PropName="Composition", PropVal="Glass", PropCategory="1")
sp_8 = SetProperty(BuildingElement=merge_4, PropName="Composition", PropVal="Aluminium", PropCategory="1")

# ---- group: assign bim data / assign spatial location based on base solid
merge_5 = Merge(Data1=bbe, Data2=bbe_2, Data3=bbe_3, Data4=bbe_4, Data5=bbe_5, Data6=bbe_6)
sp_9 = SetProperty(BuildingElement=merge_5, PropName=panel, PropVal=pv_2, PropCategory="1")

# ---- group: assign bim data / generate seauence number
lng_3 = ListLength(List=flatten(bbe))
lng_4 = ListLength(List=flatten(bbe_2))
lng_5 = ListLength(List=flatten(bbe_6))
series = Series(Start=1, Step=1, Count=lng_3)
series_2 = Series(Start=1, Step=1, Count=lng_4)
series_3 = Series(Start=1, Step=1, Count=lng_5)

# ----
panel_2 = Panel(series)
panel_3 = Panel(series_2)
panel_4 = Panel(series_3)

# ---- group: assign bim data / generate seauence number (continued)
sp_10 = SetProperty(BuildingElement=bbe, PropName="SequenceNumber", PropVal=panel_2, PropCategory="1")
sp_11 = SetProperty(BuildingElement=bbe_2, PropName="SequenceNumber", PropVal=panel_3, PropCategory="1")
sp_12 = SetProperty(BuildingElement=bbe_6, PropName="SequenceNumber", PropVal=panel_4, PropCategory="1")
