# Grasshopper definition GHcomponent_Rafter.gh (Grasshopper 1.0.7)
# plug-ins: Grasshopper-BricsCAD-Connection

# INPUT BRICSCAD WALL HERE
# (start with BcIn_)
bcin_entity = Entity()
bcin_width = Number(70)
bcin_depth = Number(210)
# INPUT BRICSCAD
# PARAMETERS HERE
# (start with BcIn_)
bcin_spacing = Number(400)
bcin_thicknessplywood = Number(18)
bcin_thicknessgypsum = Number(12)
bcin_directionangle = Number(0)
# ;This is an example script provided with the installation of BricsCAD V22.
# ;
# ;This script is provided AS IS without warranty of any kind. Author(s) disclaim all
# ;implied warranties including, without limitation, any implied warranties of
# ;merchantability or of fitness for a particular purpose. The entire risk arising out of
# ;the use or performance of the sample script and documentation remains with you. In no
# ;event shall author(s) be held liable for any damages whatsoever (including, without
# ;limitation, damages for loss of business profits, business interruption, loss of business
# ;information, or other pecuniary loss) arising out of the use of or inability to use the
# ;script or documentation. The script is not guaranteed to work with future or previous
# ;versions of BricsCAD except the one it is installed with. The presensce of the script in
# ;future versions is not guaranteed and is a subject to change within any future update to
# ;BricsCAD.
# 
# This script takes a solid as input and will generate a rafter structure considering possible openings.
# The largest surface of the solid is used as base geometry. This surface is rotated to the world XY plane and axislines of all members are calculated.
# At the end of the script all members and covers are extruded and oriented back to the original orientation.
# It puts member at the sides of the wall/slab and at the sides of the openings.
# Between these members, secondary members are added equally spaced to match the max spacing input.
# 2 Covers are added (plywood and gypsum).
# All elements are classified and get a name based on the name of the original wall/slab and a composition.
width_of_rafter = Panel(bcin_width)
depth_of_rafter = Panel(bcin_depth)
max_spacing_of_rafter = Panel(bcin_spacing)
thickness_plywood = Panel(bcin_thicknessplywood)
thickness_gypsum = Panel(bcin_thicknessgypsum)
loadbearing_direction = Panel(bcin_directionangle)
brep = Brep(bcin_entity)
volume = Volume(Geometry=brep)  # -> Volume, Centroid
rad = Radians(Degrees=loadbearing_direction)
addition = Addition(A=rad, B="pi/2-0.000001")
thickness_plywood_2 = Panel(thickness_plywood)
thickness_gypsum_2 = Panel(thickness_gypsum)
depth_of_rafter_2 = Panel(depth_of_rafter)
addition_2 = Addition(A=thickness_plywood_2, B=depth_of_rafter_2)
rad_2 = Radians(Degrees=loadbearing_direction)

# ---- group: get BIM name and spatial location of base entity
bcin_entity_2 = Entity(bcin_entity)
panel = Panel("SpatialLocation")
property_category = PropertyCategories({"Standard": 0, "Bricsys": 1, "IFC2x3": 2, "IFCCustom": 3, "User": 4, "Quantity": 5, "Classfication": 6, "IFC4": 7}, selected="Bricsys")
pv = PropertyValue(BuildingElement=bcin_entity_2, PropName="Name", PropCategory=property_category)
pv_2 = PropertyValue(BuildingElement=bcin_entity_2, PropName=panel, PropCategory=property_category)
panel_2 = Panel(pv)
panel_3 = Panel(pv_2)

# ---- group: retrieve 2 largest faces in solid pick the top one
debrep = DeconstructBrep(Brep=bcin_entity)  # -> simplify(Faces), Edges, Vertices
area = Area(Geometry=debrep.Faces)  # -> Area, Centroid
sort = SortList(Keys=area.Area, ValuesA=debrep.Faces)  # -> Keys, ValuesA

# ----
lng = ListLength(List=debrep.Faces)

# ---- group: retrieve 2 largest faces in solid pick the top one (continued)
split = SplitList(List=sort.ValuesA, Index=expr("x-2", lng))  # -> ListA, ListB
area_2 = Area(Geometry=split.ListB)  # -> Area, simplify(Centroid)
pdecon = Deconstruct(Point=area_2.Centroid)  # -> XComponent, YComponent, ZComponent
sort_2 = SortList(Keys=pdecon.ZComponent, ValuesA=split.ListB)  # -> Keys, simplify(ValuesA)
lng_2 = ListLength(List=sort_2.ValuesA)
item = ListItem(List=sort_2.ValuesA, Index=expr("x-1", lng_2), Wrap=True)
srf = Surface(item)

# ---- group: find normal of face
area_3 = Area(Geometry=srf)  # -> Area, Centroid
evalsrf = EvaluateSurface(Surface=srf, Point=area_3.Centroid)  # -> Point, Normal, UDirection, VDirection, Frame
pt_centroid = Point(area_3.Centroid)
vec_face_x = Vector(evalsrf.UDirection)
vec_face_y = Vector(evalsrf.VDirection)
vec_face_z = Vector(evalsrf.Normal)
line = LineSDL(Start=pt_centroid, Direction=vec_face_x, Length=1000)
line_2 = LineSDL(Start=pt_centroid, Direction=vec_face_y, Length=1000)
line_3 = LineSDL(Start=pt_centroid, Direction=vec_face_z, Length=1000)

# ----
end = EndPoints(Curve=line)  # -> Start, End
end_2 = EndPoints(Curve=line_2)  # -> Start, End
pl_3pt = Plane3Pt(PointA=end.Start, PointB=end.End, PointC=end_2.End)

# ---- group: find normal of face (continued)
pln = Plane(pl_3pt)

# ----
orient = Orient(Geometry=volume.Centroid, Source=pln, Target=PlaneXY(0, 0, 0))  # -> flatten(Geometry), Transform
pdecon_2 = Deconstruct(Point=orient.Geometry)  # -> XComponent, YComponent, ZComponent
pt = ConstructPoint(XCoordinate=0, YCoordinate=0, ZCoordinate=pdecon_2.ZComponent)
vec_centroid = UnitVector(Vector=pt)
normal = Vector(vec_centroid)
normal_2 = Vector(vec_centroid)
amp = Amplitude(Vector=normal_2, Amplitude=thickness_plywood_2)
amp_2 = Amplitude(Vector=normal_2, Amplitude=thickness_gypsum_2)
amp_3 = Amplitude(Vector=normal_2, Amplitude=addition_2)

# ---- group: work in plane coordinates
srf_2 = Surface(srf)
orient_2 = Orient(Geometry=srf_2, Source=pln, Target=PlaneXY(0, 0, 0))  # -> flatten(Geometry), Transform
Z = UnitZ(Factor=1)

# ----
rotate = Rotate(Geometry=orient_2.Geometry, Angle=rad, Plane=PlaneXY(0, 0, 0))  # -> Geometry, Transform

# ---- group: work in plane coordinates (continued)
srf_3 = Surface(rotate.Geometry)
debrep_2 = DeconstructBrep(Brep=srf_3)  # -> simplify(Faces), simplify(Edges), Vertices
area_4 = Area(Geometry=srf_3)  # -> Area, Centroid
evalsrf_2 = EvaluateSurface(Surface=srf_3, Point=area_4.Centroid)  # -> Point, Normal, UDirection, VDirection, Frame
pl = PlaneNormal(Origin=area_4.Centroid, ZAxis=evalsrf_2.Normal)

# ---- group: search opening and edge contour
join = JoinCurves(Curves=debrep_2.Edges, Preserve=False)  # -> simplify(Curves)
area_5 = Area(Geometry=join)  # -> Area, Centroid
sort_3 = SortList(Keys=area_5.Area, ValuesA=join)  # -> Keys, simplify(ValuesA)
lng_3 = ListLength(List=sort_3.ValuesA)
split_2 = SplitList(List=sort_3.ValuesA, Index=expr("x-1", lng_3))  # -> simplify(ListA), simplify(ListB)
crv_of_outeredge = Curve(split_2.ListB)
crv_of_openings = Curve(split_2.ListA)

# ----
merge = Merge(Data1=crv_of_openings, Data2=crv_of_outeredge)
merge_2 = Merge(Data1=crv_of_openings, Data2=crv_of_outeredge)

# ---- group: offset to find verticals
offset_outer_contour = OffsetCurve(Curve=merge, Distance=expr("-x/2", width_of_rafter), Plane=pl, Corners=1)  # -> flatten(Curve)
explode = Explode(Curve=offset_outer_contour, Recursive=True)  # -> flatten(Segments), Vertices
crv = Curve(explode.Segments)

# ---- group: subtracter volume openings
offset_opening = OffsetCurve(Curve=crv_of_openings, Distance=expr("-x/2", width_of_rafter), Plane=pl, Corners=1)  # -> flatten(Curve)
Z_2 = UnitZ(Factor=1)
multiplication = Multiplication(A=depth_of_rafter, _3=-3)
amp_4 = Amplitude(Vector=Z_2, Amplitude=multiplication)
extr = Extrude(Base=offset_opening, Direction=amp_4)
multiplication_2 = Multiplication(A=depth_of_rafter, B=1)
amp_5 = Amplitude(Vector=Z_2, Amplitude=multiplication_2)
cap = CapHoles(Brep=extr)
move = Move(Geometry=cap, Motion=amp_5)  # -> Geometry, Transform
subtractor_openingen = Brep(move.Geometry)

# ----
srf_face_of_wall = Surface(srf_3)
extr_2 = Extrude(Base=srf_face_of_wall, Direction=amp_2)
extr_3 = Extrude(Base=srf_face_of_wall, Direction=amp)
move_2 = Move(Geometry=extr_2, Motion=amp_3)  # -> Geometry, Transform
rotate_2 = Rotate(Geometry=extr_3, Angle=expr("-x", rad_2), Plane=PlaneXY(0, 0, 0))  # -> Geometry, Transform
rotate_3 = Rotate(Geometry=move_2.Geometry, Angle=expr("-x", rad_2), Plane=PlaneXY(0, 0, 0))  # -> Geometry, Transform
orient_3 = Orient(Geometry=rotate_2.Geometry, Source=PlaneXY(0, 0, 0), Target=pln)  # -> Geometry, Transform
orient_4 = Orient(Geometry=rotate_3.Geometry, Source=PlaneXY(0, 0, 0), Target=pln)  # -> Geometry, Transform

# ---- group: main hor and vert
boundary = BoundarySurfaces(Edges=crv)
boundary_2 = BoundarySurfaces(Edges=merge_2)
edgesdir = EdgesFromDirections(Brep=boundary, Directions=evalsrf_2.UDirection, Reflex=True, Angle=rad)  # -> simplify(flatten(Edges)), Indices, Map
edgesdir_2 = EdgesFromDirections(Brep=boundary_2, Directions=evalsrf_2.UDirection, Reflex=True, Angle=rad)  # -> simplify(flatten(Edges)), Indices, Map
edgesdir_3 = EdgesFromDirections(Brep=boundary, Directions=evalsrf_2.VDirection, Reflex=True, Angle=addition)  # -> simplify(flatten(Edges)), Indices, Map
edgesdir_4 = EdgesFromDirections(Brep=boundary_2, Directions=evalsrf_2.VDirection, Reflex=True, Angle=addition)  # -> simplify(flatten(Edges)), Indices, Map

# ----
non_vertical_offset_border = Curve(edgesdir_3.Edges)
vertical_offset_openings = Curve(edgesdir.Edges)
non_vertical = Curve(edgesdir_4.Edges)
vertical = Curve(edgesdir_2.Edges)

# ---- group: main hor and vert (continued)
non_vertical_offset_border_2 = Curve(non_vertical_offset_border)
vertical_offset_openings_2 = Curve(vertical_offset_openings)
non_vertical_2 = Curve(non_vertical)
vertical_2 = Curve(vertical)

# ---- group: VERTICAL
end_3 = EndPoints(Curve=vertical_offset_openings_2)  # -> Start, End
pdecon_3 = Deconstruct(Point=end_3.Start)  # -> XComponent, YComponent, ZComponent
sort_4 = SortList(Keys=pdecon_3.YComponent, ValuesA=vertical_offset_openings_2)  # -> Keys, ValuesA
pt_2 = ConstructPoint(XCoordinate=-50000, YCoordinate=sort_4.Keys, ZCoordinate=0)
pt_3 = ConstructPoint(XCoordinate=50000, YCoordinate=sort_4.Keys, ZCoordinate=0)
ln = Line(StartPoint=pt_3, EndPoint=pt_2)  # -> simplify(Line)
flatten = FlattenTree(Tree=non_vertical_offset_border_2, Path="{0}")
ccx = CurveCurve(CurveA=graft(ln), CurveB=flatten)  # -> Points, ParamsA, ParamsB
pshift = ShiftPaths(Data=ccx.Points, Offset=-1)
sort_pt = SortPoints(Points=pshift)  # -> Points, Indices
rev = ReverseList(List=sort_pt.Points)
item_2 = ListItem(List=sort_pt.Points, Index=0, Wrap=True)
item_3 = ListItem(List=rev, Index=0, Wrap=True)
ln_2 = Line(StartPoint=item_2, EndPoint=item_3)  # -> flatten(Line)
end_4 = EndPoints(Curve=ln_2)  # -> Start, End
pdecon_4 = Deconstruct(Point=end_4.Start)  # -> XComponent, YComponent, ZComponent
sort_5 = SortList(Keys=pdecon_4.YComponent, ValuesA=ln_2)  # -> Keys, ValuesA
main_vertical_sorted = Curve(sort_5.ValuesA)

# ---- group: secundary verticals
main_vertical_sorted_2 = Curve(main_vertical_sorted)
lng_4 = ListLength(List=main_vertical_sorted_2)
shift = ShiftList(List=main_vertical_sorted_2, Shift=1, Wrap=False)
split_3 = SplitList(List=main_vertical_sorted_2, Index=expr("x-1", lng_4))  # -> ListA, ListB
end_5 = EndPoints(Curve=shift)  # -> Start, End
end_6 = EndPoints(Curve=split_3.ListA)  # -> Start, End
pdecon_5 = Deconstruct(Point=end_6.Start)  # -> XComponent, YComponent, ZComponent
pdecon_6 = Deconstruct(Point=end_5.Start)  # -> XComponent, YComponent, ZComponent
subtraction = Subtraction(A=pdecon_6.YComponent, B=pdecon_5.YComponent)
division = Division(A=subtraction, B=max_spacing_of_rafter)
round = Round(Number=division)  # -> Nearest, Floor, Ceiling
division_2 = Division(A=subtraction, B=round.Ceiling)
series = Series(Start=division_2, Step=division_2, Count=round.Floor)  # -> simplify(Series)
addition_3 = Addition(A=graft(pdecon_5.YComponent), B=series)  # -> simplify(Result)
pt_4 = ConstructPoint(XCoordinate=50000, YCoordinate=addition_3, ZCoordinate=0)
pt_5 = ConstructPoint(XCoordinate=-50000, YCoordinate=addition_3, ZCoordinate=0)
ln_3 = Line(StartPoint=pt_4, EndPoint=pt_5)
flatten_2 = FlattenTree(Tree=ln_3, Path="{0}")
flatten_3 = FlattenTree(Tree=non_vertical_offset_border_2, Path="{0}")
ccx_2 = CurveCurve(CurveA=graft(ln_3), CurveB=flatten_3)  # -> simplify(Points), ParamsA, ParamsB
pshift_2 = ShiftPaths(Data=ccx_2.Points, Offset=-1)
sort_pt_2 = SortPoints(Points=pshift_2)  # -> Points, Indices
rev_2 = ReverseList(List=sort_pt_2.Points)
item_4 = ListItem(List=sort_pt_2.Points, Index=0, Wrap=True)
item_5 = ListItem(List=rev_2, Index=0, Wrap=True)
ln_4 = Line(StartPoint=item_4, EndPoint=item_5)  # -> flatten(Line)
secondary_vertical_sorted = Curve(ln_4)

# ---- group: trim lines
subtractor_openings = Brep(subtractor_openingen)
trim = TrimWithBreps(Curve=secondary_vertical_sorted, Brep=subtractor_openings)  # -> Inside, flatten(Outside)
null = NullItem(Item=subtractor_openings)  # -> NullFlags, InvalidFlags, Description
vb_if = VBScript(x=null.NullFlags, y=secondary_vertical_sorted, z=trim.Outside)  # -> out, simplify(A)
# ---------- vb_if: VB ----------
    If x  :
      A = y
    Else:
      A = z
    End If
# ---------- end vb_if ----------
secondary_vertical_trimmed = Curve(vb_if.A)
main_vertical_sorted_3 = Curve(main_vertical_sorted)
merge_3 = Merge(Data1=secondary_vertical_trimmed, Data2=main_vertical_sorted_3)

# ---- group: primary horizontals
offset_crv_horizontal = Curve(non_vertical_2)
xprod = CrossProduct(VectorA=offset_crv_horizontal, VectorB=normal, Unitize=True)  # -> Vector, Length
amp_6 = Amplitude(Vector=normal, Amplitude=depth_of_rafter)
extr_4 = Extrude(Base=offset_crv_horizontal, Direction=amp_6)
amp_7 = Amplitude(Vector=xprod.Vector, Amplitude=width_of_rafter)
extr_5 = Extrude(Base=extr_4, Direction=amp_7)
cap_2 = CapHoles(Brep=extr_5)

# ---- group: vertical extrude
ext = ExtendCurve(Curve=merge_3, Type=0, Start=expr("-x/2", width_of_rafter), End=expr("-x/2", width_of_rafter))
amp_8 = Amplitude(Vector=normal, Amplitude=depth_of_rafter)
Y = UnitY(Factor=1)
extr_6 = Extrude(Base=ext, Direction=amp_8)
amp_9 = Amplitude(Vector=Y, Amplitude=width_of_rafter)
extr_7 = Extrude(Base=extr_6, Direction=amp_9)
amp_10 = Amplitude(Vector=Y, Amplitude=expr("-x/2", width_of_rafter))
move_3 = Move(Geometry=extr_7, Motion=amp_10)  # -> Geometry, Transform

# ----
extruded_horizontals = Geometry(cap_2)
extruded_verticals = Geometry(move_3.Geometry)
merge_4 = Merge(Data1=extruded_verticals, Data2=extruded_horizontals)
move_4 = Move(Geometry=merge_4, Motion=amp)  # -> Geometry, Transform
rotate_4 = Rotate(Geometry=move_4.Geometry, Angle=expr("-x", rad_2), Plane=PlaneXY(0, 0, 0))  # -> Geometry, Transform
orient_5 = Orient(Geometry=rotate_4.Geometry, Source=PlaneXY(0, 0, 0), Target=pln)  # -> Geometry, Transform

# ---- group: OUTPUT GEOMETRY
plywood = Brep(orient_3.Geometry)
gypsum = Brep(orient_4.Geometry)
rafters = Brep(orient_5.Geometry)

# ----
merge_5 = Merge(Data1=rafters, Data2=plywood, Data3=gypsum)
brep_2 = Brep(merge_5)

# ---- group: Assign bim data / assign Bim type
bim_type = BIMTypes({"BimGenericBuildingElt": 0, "BimSection": 1, "BimWall": 2, "BimWindow": 3, "BimDoor": 4, "BimColumn": 5, "BimSlab": 6, "BimBeam": 7, "BimRoom": 8, "BimCovering": 9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}, selected="BimMember": 13)
bim_type_2 = BIMTypes({"BimGenericBuildingElt": 0, "BimSection": 1, "BimWall": 2, "BimWindow": 3, "BimDoor": 4, "BimColumn": 5, "BimSlab": 6, "BimBeam": 7, "BimRoom": 8, "BimCovering": 9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}, selected="BimCovering")
bbe = BakeBuildingElement(Geometry=rafters, ElementType=bim_type)
bbe_2 = BakeBuildingElement(Geometry=plywood, ElementType=bim_type_2)
bbe_3 = BakeBuildingElement(Geometry=gypsum, ElementType=bim_type_2)

# ---- group: Assign bim data / number the members
lng_5 = ListLength(List=bbe)
series_2 = Series(Start=1, Step=1, Count=lng_5)
panel_4 = Panel(series_2)
sp = SetProperty(BuildingElement=bbe, PropName="SequenceNumber", PropVal=panel_4, PropCategory="1")

# ---- group: Assign bim data / assign unique names based on original entity
concat = Concatenate(FragmentA=pv, FragmentB=" Rafter ")
concat_2 = Concatenate(FragmentA=pv, FragmentB=" inside cover")
concat_3 = Concatenate(FragmentA=pv, FragmentB=" outside cover")
sp_2 = SetProperty(BuildingElement=bbe, PropName="Name", PropVal=concat, PropCategory="1")
sp_3 = SetProperty(BuildingElement=bbe_2, PropName="Name", PropVal=concat_3, PropCategory="1")
sp_4 = SetProperty(BuildingElement=bbe_3, PropName="Name", PropVal=concat_2, PropCategory="1")

# ---- group: Assign bim data / assign composition
sp_5 = SetProperty(BuildingElement=bbe, PropName="Composition", PropVal="Wood, Pine", PropCategory="1")
sp_6 = SetProperty(BuildingElement=bbe_2, PropName="Composition", PropVal="Board, Multi-ply", PropCategory="1")
sp_7 = SetProperty(BuildingElement=bbe_3, PropName="Composition", PropVal="Gypsum Board", PropCategory="1")

# ---- group: Assign bim data / assign spatial location of the original entity
merge_6 = Merge(Data1=bbe, Data2=bbe_2, Data3=bbe_3)
sp_8 = SetProperty(BuildingElement=merge_6, PropName=panel, PropVal=pv_2, PropCategory=property_category)
